# Grasshopper definition textured_wall_arrayer.gh (Grasshopper 1.0.8)

brep = Brep(<brep referenced from the Rhino model>)
crv = Curve(<curve referenced from the Rhino model>)
edges = BrepEdges(Brep=brep)  # -> Naked, Interior, NonManifold
eval = EvaluateCurve(Curve=crv, Parameter=Slider(0, range=0..1))  # -> Point, Tangent, Angle
pframes = PerpFrames(Curve=crv, Count=Slider(100, range=1..100), Align=True)  # -> Frames, Parameters
xy = XYPlane(Origin=Point(0, 0, 0))
Z = UnitZ(Factor=1)
pl = ConstructPlane(Origin=pframes.Frames, XAxis=eval.Tangent, YAxis=Z)
orient = Orient(Geometry=brep, Source=xy, Target=pl)  # -> Geometry, Transform
