# Grasshopper definition voronai.gh (Grasshopper 1.0.8)

point_density = Slider(0.017, range=0..0.1)
crv = Curve([<curve referenced from the Rhino model> x6])
graft = GraftTree(Tree=crv, IncludeEmptyLists=True, IncludeNullItems=True)
area = Area(Geometry=graft)  # -> Area, Centroid
multiplication = Multiplication(A=area.Area, B=point_density)
pop2d = Populate2D(Region=graft, Count=multiplication, Seed=Slider(0, range=0..100))
number_slider = Slider(-1.363, range=-5..0)
voronoi = Voronoi(Points=pop2d, Boundary=graft, BruteForceOverride=False)
offset = OffsetCurve(Curve=flatten(voronoi), Distance=number_slider, Corners=1)
offset_2 = OffsetCurve(Curve=graft, Distance=number_slider, Corners=1)
rint = RegionIntersection(CurvesA=flatten(offset), CurvesB=offset_2)
boundary = BoundarySurfaces(Edges=graft)
join = JoinCurves(Curves=flatten(rint), Preserve=False)
Z = UnitZ(Factor=Slider(3, range=0..20))
boundary_2 = BoundarySurfaces(Edges=join)
extr = Extrude(Base=boundary, Direction=Z)
extr_2 = Extrude(Base=boundary_2, Direction=Z)
sdiff = SolidDifference(BrepsA=flatten(extr), BrepsB=flatten(extr_2))
