# Grasshopper definition bail_generator.gh (Grasshopper 1.0.8)

cap_radius = Slider(2.12, range=0..10)
flute_count = Slider(8, range=0..50)
chain_hole_diameter = Slider(1.5, range=0..10)
flute_depth = Slider(0.65, range=0..3)
loop_width = Slider(5, range=0..10)
cap_radius_2 = Slider(4.92, range=0..10)
flute_count_2 = Slider(16, range=0..50)
loop_thickness = Slider(1.5, range=0..10)
wall_thickness = Slider(1, range=0..10)
clearance = Slider(0.01, range=0..0.5)
number_of_steps = Slider(200, range=0..1000)
num = Number(2)
pi = Pi(Factor=1)
multiplication = Multiplication(A=num, B=pi)
dome_height = Slider(4, range=0..10)
range = Range(Domain=multiplication, Steps=number_of_steps)
expression = Expression(
    x=range,
    y=flute_count,
    z=cap_radius,
    u=wall_thickness,
    v=clearance,
    w=flute_depth,
    Expression="(z + u + v ) + w * sin(x * y)")
expression_2 = Expression(
    x=range,
    y=flute_count_2,
    z=cap_radius_2,
    u=wall_thickness,
    v=clearance,
    w=flute_depth,
    Expression="(z + u + v ) + w * sin(x * y)")
expression_3 = Expression(x=cap_radius_2, y=wall_thickness, z=clearance, Expression="x+y+z")
num_2 = Number(0)
dome_sample_r2 = Slider(4.2, range=0..10)
dome_sample_r1 = Slider(4.7, range=0..10)
pt = ConstructPoint(XCoordinate=num_2, YCoordinate=num_2, ZCoordinate=num_2)
pt_2 = PointPolar(BasePlane=PlaneXY(0, 0, 0), XYAngle=range, ZAngle=0, Offset=expression)
dome_sample_r3 = Slider(3.2, range=0..10)
pt_3 = PointPolar(BasePlane=PlaneXY(0, 0, 0), XYAngle=range, ZAngle=0, Offset=expression_2)
circle = CircleCNR(Center=pt, Normal=Vector(0, 0, 1), Radius=expression_3)
tip_radius = Slider(1.5, range=0..3)
extra_height_flutes = Slider(1.7, range=0..10)
toggle = BooleanToggle(True)
intcrv = Interpolate(Vertices=pt_2, Degree=3, Periodic=toggle, KnotStyle=1)  # -> Curve, Length, Domain
intcrv_2 = Interpolate(Vertices=pt_3, Degree=3, Periodic=toggle, KnotStyle=1)  # -> Curve, Length, Domain
bail_height_straight = Slider(9, range=0..10)
addition = Addition(A=bail_height_straight, B=extra_height_flutes)
Z = UnitZ(Factor=addition)
extr = Extrude(Base=circle, Direction=Z)
cap = CapHoles(Brep=extr)
expression_4 = Expression(x=bail_height_straight, y=dome_height, Expression="x+y")
extr_2 = Extrude(Base=intcrv_2.Curve, Direction=Z)
expression_5 = Expression(x=cap_radius_2, y=clearance, z=wall_thickness, Expression="x+y+z")
expression_6 = Expression(x=bail_height_straight, y=dome_height, Expression="x+3*y/4")
expression_7 = Expression(x=cap_radius_2, y=clearance, z=wall_thickness, Expression="x+y+z")
expression_8 = Expression(x=bail_height_straight, y=dome_height, Expression="x+y/4")
addition_2 = Addition(A=dome_sample_r1, B=wall_thickness)
expression_9 = Expression(x=bail_height_straight, y=dome_height, Expression="x+y/2")
addition_3 = Addition(A=dome_sample_r3, B=wall_thickness)
addition_4 = Addition(A=dome_sample_r2, B=wall_thickness)
# Tip
addition_5 = Addition(A=tip_radius, B=wall_thickness)
num_3 = Number(0)
num_4 = Number(0)
num_5 = Number(0)
num_6 = Number(0)
num_7 = Number(0)
num_8 = Number(0)
# Dome sample 1
pt_4 = ConstructPoint(XCoordinate=addition_2, YCoordinate=num_3, ZCoordinate=expression_8)
# Dome sample 3
pt_5 = ConstructPoint(XCoordinate=addition_3, YCoordinate=num_4, ZCoordinate=expression_6)
# Dome sample 2
pt_6 = ConstructPoint(XCoordinate=addition_4, YCoordinate=num_5, ZCoordinate=expression_9)
cap_2 = CapHoles(Brep=extr_2)
# Outer
# Base
pt_7 = ConstructPoint(XCoordinate=expression_5, YCoordinate=num_6, ZCoordinate=num_6)
# Top of straight section
pt_8 = ConstructPoint(XCoordinate=expression_7, YCoordinate=num_8, ZCoordinate=bail_height_straight)
number_slider = Slider(3.25, range=0..10)
pt_9 = ConstructPoint(XCoordinate=addition_5, YCoordinate=num_7, ZCoordinate=expression_4)
sdiff = SolidDifference(BrepsA=cap, BrepsB=cap_2)
expression_10 = Expression(x=expression_6, y=number_slider, z=expression_6, Expression="x+y+.3")
num_9 = Number(0)
intcrv_3 = Interpolate(Vertices=[pt_8, pt_4, pt_6, pt_5, pt_9], Degree=3, Periodic=False, KnotStyle=1)  # -> Curve, Length, Domain
num_10 = Number(-1)
ln = Line(StartPoint=pt_7, EndPoint=pt_8)
num_11 = Number(10)
num_12 = Number(0)
number_slider_2 = Slider(5.3, range=0..100)
multiplication_2 = Multiplication(A=num_10, B=number_slider_2)
num_13 = Number(-1)
pt_10 = ConstructPoint(XCoordinate=num_12, YCoordinate=num_12, ZCoordinate=num_11)
join = JoinCurves(Curves=[ln, intcrv_3.Curve], Preserve=False)
pt_11 = ConstructPoint(XCoordinate=num_12, YCoordinate=num_12, ZCoordinate=num_12)
hole_size = Slider(-1.5, range=-4..0)
num_14 = Number(0)
multiplication_3 = Multiplication(A=wall_thickness, B=num_13)
pt_12 = ConstructPoint(XCoordinate=num_14, YCoordinate=multiplication_2, ZCoordinate=expression_10)
ln_2 = Line(StartPoint=pt_11, EndPoint=pt_10)
revsrf = Revolution(Curve=join, Axis=ln_2, Domain=Domain(0, 6.283185307))
addition_6 = Addition(A=number_slider, B=hole_size)
Y = UnitY(Factor=1)
# Inner
offset = OffsetCurve(Curve=join, Distance=multiplication_3, Corners=1)
num_15 = Number(2)
cap_3 = CapHoles(Brep=revsrf)
pl = PlaneNormal(Origin=pt_12, ZAxis=Y)
multiplication_4 = Multiplication(A=num_15, B=number_slider_2)
pt_13 = ConstructPoint(XCoordinate=num_9, YCoordinate=num_9, ZCoordinate=expression_10)
revsrf_2 = Revolution(Curve=offset, Axis=ln_2, Domain=Domain(0, 6.283185307))
cap_4 = CapHoles(Brep=revsrf_2)
sph = Sphere(Base=pt_13, Radius=number_slider)
cyl = Cylinder(Base=pl, Radius=addition_6, Length=multiplication_4)
sdiff_2 = SolidDifference(BrepsA=cap_3, BrepsB=cap_4)
sdiff_3 = SolidDifference(BrepsA=sph, BrepsB=cyl)
sdiff_4 = SolidDifference(BrepsA=sdiff_2, BrepsB=sdiff)
merge = Merge(Data1=sdiff_4, Data2=sdiff_3)
num_16 = Number(0.7)
sunion = SolidUnion(Breps=flatten(merge))
num_17 = Number(2)
number_slider_3 = Slider(1.48, range=0..10)
addition_7 = Addition(A=num_16, B=cap_radius_2)
addition_8 = Addition(A=num_17, B=cap_radius_2)
debrep = DeconstructBrep(Brep=sunion)  # -> Faces, Edges, Vertices
cyl_2 = Cylinder(Base=PlaneXY(0, 0, 0), Radius=addition_7, Length=number_slider_3)
cyl_3 = Cylinder(Base=PlaneXY(0, 0, 0), Radius=addition_8, Length=number_slider_3)
midpt = CurveMiddle(Curve=debrep.Edges)
cap_5 = CapHoles(Brep=cyl_2)
cap_6 = CapHoles(Brep=cyl_3)
edge_select = Slider(154, range=0..200)
edge_select_2 = Slider(152, range=0..200)
edge_select_3 = Slider(151, range=0..200)
number_slider_4 = Slider(0.2, range=0..1)
points = PointList(Points=midpt)
sdiff_5 = SolidDifference(BrepsA=cap_6, BrepsB=cap_5)
brepsinc = PointInBreps(Brep=sdiff_5, Point=midpt, Strict=False)  # -> Inside, Index
mindex = MemberIndex(Set=brepsinc.Inside, Member=Toggle(True))  # -> Index, Count
lng = ListLength(List=mindex.Index)
dup = DuplicateData(Data=Slider(0.636, range=0..1), Number=lng, Order=True)
merge_2 = Merge(Data1=number_slider_4, Data2=number_slider_4, Data3=Slider(0.188, range=0..1), Data4=flatten(dup))
merge_3 = Merge(Data1=edge_select_3, Data2=edge_select_2, Data3=edge_select, Data4=flatten(mindex.Index))
filedge = FilletEdge(Shape=sunion, Blend=0, Metric=0, Edges=merge_3, Radii=merge_2)
